# Grasshopper definition Radial_Slit.gh (Grasshopper 1.0.8)

# ---- group: Detailed parameter adjustment
central_slit_position = Slider(4, range=0..100)
central_slit_length = Slider(13, range=0..100)
inner_slit_length = Slider(8, range=0..100)
outer_slit_length = Slider(8, range=0..100)

# ---- group: ignore
切缝宽度 = Slider(0.2, range=0..1)

# ---- group: Global adjustment
outer_radius = Slider(30, range=0..100)
inner_radius = Slider(10, range=0..100)
number_of_equal_divisions = Slider(18, range=0..100)

# ---- group: ignore
气道口长度 = Slider(60, range=0..100)
气道口宽度 = Slider(8, range=0..100)

# ----
cir = Circle(Plane=PlaneXY(0, 0, 0), Radius=inner_radius)
cir_2 = Circle(Plane=PlaneXY(0, 0, 0), Radius=outer_radius)
rectangle = Rectangle(Plane=PlaneXY(0, 0, 0), XSize=气道口长度, YSize=气道口宽度, Radius=0)  # -> Rectangle, Length
division = Division(A=切缝宽度, B="2")
neg = Negative(Value=outer_slit_length)
srf = Surface(cir_2)
subtraction = Subtraction(A=outer_radius, B="2")
offset = OffsetCurve(Curve=cir, Distance=inner_slit_length, Corners=1)
offset_2 = OffsetCurve(Curve=cir, Distance=central_slit_position, Corners=1)
offset_3 = OffsetCurve(Curve=offset_2, Distance=central_slit_length, Corners=1)
divide = DivideCurve(Curve=cir, Count=number_of_equal_divisions, Kinks=False)  # -> Points, Tangents, Parameters
offset_4 = OffsetCurve(Curve=cir_2, Distance=neg, Corners=1)
X = UnitX(Factor=subtraction)
divide_2 = DivideCurve(Curve=offset_2, Count=number_of_equal_divisions, Kinks=False)  # -> Points, Tangents, Parameters
divide_3 = DivideCurve(Curve=offset_3, Count=number_of_equal_divisions, Kinks=False)  # -> Points, Tangents, Parameters
offset_5 = OffsetCurve(Curve=cir, Distance="0.005", Corners=1)
divide_4 = DivideCurve(Curve=offset, Count=number_of_equal_divisions, Kinks=False)  # -> Points, Tangents, Parameters
divide_5 = DivideCurve(Curve=cir_2, Count=number_of_equal_divisions, Kinks=False)  # -> Points, Tangents, Parameters
divide_6 = DivideCurve(Curve=offset_4, Count=number_of_equal_divisions, Kinks=False)  # -> Points, Tangents, Parameters
neg_2 = Negative(Value=division)
ln = Line(StartPoint=divide.Points, EndPoint=divide_4.Points)
move = Move(Geometry=rectangle.Rectangle, Motion=X)  # -> Geometry, Transform
division_2 = Division(A=气道口宽度, B="2")
division_3 = Division(A="180", B=number_of_equal_divisions)
rotate = Rotate(Geometry=divide_2.Points, Angle=degrees(division_3), Plane=PlaneXY(0, 0, 0))  # -> Geometry, Transform
rotate_2 = Rotate(Geometry=divide_3.Points, Angle=degrees(division_3), Plane=PlaneXY(0, 0, 0))  # -> Geometry, Transform
neg_3 = Negative(Value=division_2)
ln_2 = Line(StartPoint=divide_5.Points, EndPoint=divide_6.Points)
ln_3 = Line(StartPoint=rotate.Geometry, EndPoint=rotate_2.Geometry)
Y = UnitY(Factor=neg_3)
move_2 = Move(Geometry=move.Geometry, Motion=Y)  # -> Geometry, Transform
offset_6 = OffsetCurve(Curve=ln, Distance=division, Corners=1)
offset_7 = OffsetCurve(Curve=ln, Distance=neg_2, Corners=1)
offset_8 = OffsetCurve(Curve=ln_3, Distance=division, Corners=1)
offset_9 = OffsetCurve(Curve=ln_3, Distance=neg_2, Corners=1)
offset_10 = OffsetCurve(Curve=ln_2, Distance=division, Corners=1)
offset_11 = OffsetCurve(Curve=ln_2, Distance=neg_2, Corners=1)
srf_2 = Surface(move_2.Geometry)
end = EndPoints(Curve=offset_6)  # -> Start, End
end_2 = EndPoints(Curve=offset_7)  # -> Start, End
end_3 = EndPoints(Curve=offset_8)  # -> Start, End
end_4 = EndPoints(Curve=offset_9)  # -> Start, End
end_5 = EndPoints(Curve=offset_10)  # -> Start, End
end_6 = EndPoints(Curve=offset_11)  # -> Start, End
sunion = SolidUnion(Breps=[srf_2, srf])
ln_4 = Line(StartPoint=end.Start, EndPoint=end_2.Start)
ln_5 = Line(StartPoint=end.End, EndPoint=end_2.End)
ln_6 = Line(StartPoint=end_3.Start, EndPoint=end_4.Start)
ln_7 = Line(StartPoint=end_3.End, EndPoint=end_4.End)
ln_8 = Line(StartPoint=end_5.Start, EndPoint=end_6.Start)
ln_9 = Line(StartPoint=end_5.End, EndPoint=end_6.End)
edges = BrepEdges(Brep=sunion)  # -> Naked, Interior, NonManifold
crv = Curve(edges.Naked)
join = JoinCurves(Curves=crv, Preserve=False)
fillet = Fillet(Curve=join, Radius=Slider(1, range=0..1))
merge = Merge(Data1=ln, Data2=ln_3, Data3=ln_2, Data4=fillet, Data5=offset_5)
